# Grasshopper definition MeshColoredFaces.gh (Grasshopper 0.9.76)
# plug-ins: MeshEdit Components, Spectacles.GrasshopperExporter

# ----
# copyright: Thornton Tomasetti, Inc.
# Author: Ana Garcia Puyol
# agarciapuyol@ThorntonTomasetti.com
# Date: 09/17/2015
# Revision: 0
# GH: 0.9.0076
# 1. Mesh a surface
number_slider = Slider(5, range=0..10)

# ----
# 3. Create a View
number_slider_2 = Slider(50, range=0..100)

pt = ConstructPoint(XCoordinate=0, YCoordinate=0, ZCoordinate=0)
pt_2 = ConstructPoint(XCoordinate=0, YCoordinate=0, ZCoordinate=Slider(25, range=0..100))
pt_3 = ConstructPoint(XCoordinate=0, YCoordinate=0, ZCoordinate=Slider(54, range=0..100))
circle = CircleCNR(Center=pt_2, Normal=Vector(0, 0, 1), Radius=Slider(6.8, range=0..10))
circle_2 = CircleCNR(Center=pt, Normal=Vector(0, 0, 1), Radius=number_slider)
circle_3 = CircleCNR(Center=pt_3, Normal=Vector(0, 0, 1), Radius=Slider(4.3, range=0..10))

pt_4 = ConstructPoint(XCoordinate=0, YCoordinate=0, ZCoordinate=Slider(36, range=0..100))
pt_5 = ConstructPoint(XCoordinate=number_slider_2, YCoordinate=0, ZCoordinate=0)

# ---- group: RH_Input
pt_6 = Point(Point(0, 0, 0))

pt_7 = Point(Point(0, 0, 0))

# ----
vec2pt = Vector2Pt(PointA=pt_5, PointB=pt_4, Unitize=False)  # -> Vector, Length

# ---- group: Input
pt_8 = Point(Point(0, 0, 0))

pt_9 = Point(Point(0, 0, 0))

# ---- group: Spectacles view
spectacles_views = Spectacles_Views(EyePosition=pt_5, Target=pt_4, Name="viewSample")

# ---- group: Visualize view
vdisex = VectorDisplayEx(Point=pt_5, Vector=vec2pt.Vector, Colour=RGB(0, 0, 0), Width=2)

# ---- group: Operation
pt_10 = Point(Point(0, 0, 0))

pt_11 = Point(Point(0, 0, 0))

# ----
crv = Curve(circle)
crv_2 = Curve(circle_2)
crv_3 = Curve(circle_3)

# ---- group: Output
pt_12 = Point(Point(0, 0, 0))

pt_13 = Point(Point(0, 0, 0))

# ---- group: Visualization
pt_14 = Point(Point(0, 0, 0))

pt_15 = Point(Point(0, 0, 0))

# ---- group: Meshed surface
merge = Merge(Data1=crv_2, Data2=crv, Data3=crv_3)
loft = Loft(Curves=merge, Options={Adjust=False, Closed=False, LoftEnds=0, LoftSimp=0, LoftType=0, Rebuild=10, Refit=0.01})
mesh_uv = MeshSurface(Surface=loft, UCount=Slider(37, range=0..100), VCount=Slider(46, range=0..100), Overhang=True, Equalize=False)

# ----
export = BooleanToggle(False)

# ---- group: GH Output Mesh
mesh = Mesh(mesh_uv)

# ---- group: Mesh to export
mesh_2 = Mesh(mesh)

# ---- group: Color Mesh Faces by their surface area
explode = MeshExplode(Mesh=mesh_2, Interpolate=False)
area = Area(Geometry=explode)  # -> Area, Centroid
bnd = Bounds(Numbers=area.Area)
dedomain = DeconstructDomain(Domain=bnd)  # -> Start, End
gradient = Gradient(
    LowerLimit=dedomain.Start,
    UpperLimit=dedomain.End,
    Parameter=area.Area,
    stops=[0: RGB(0, 128, 0), 0.5: RGB(255, 255, 0), 1: RGB(255, 0, 0)])

# ---- group: Spectacles Mesh Element
# Change the path to your folder
# Set to True to export geometry
spectacles_meshcoloredfaces = Spectacles_MeshColoredFaces(Mesh=mesh_2, Colors=gradient)

# ----
# 2. Create a Mesh Element
preview = CustomPreview(Geometry=explode, Shader=gradient)

# ----
# 4. Export Spectacles model
spectacles_scenecompiler = Spectacles_SceneCompiler(
    Write=export,
    FilePath="C:\Users\AGarciaPuyol\Desktop\MeshColoredFaces.json",
    Elements=flatten([spectacles_views, spectacles_meshcoloredfaces]))
