# Grasshopper definition MeshLambert_LineBasic.gh (Grasshopper 0.9.76)
# plug-ins: Spectacles.GrasshopperExporter

# ----
# copyright: Thornton Tomasetti, Inc.
# Author: Ana Garcia Puyol
# agarciapuyol@ThorntonTomasetti.com
# Date: 09/17/2015
# Revision: 0
# GH: 0.9.0076
# 1. Mesh a surface
number_slider = Slider(5, range=0..10)

# ----
# Define the names of the attributes to display when the element is selected on the web
attribute_names = Panel("Material")
# Define the values of the attributes to display when the element is selected on the web
attribute_values = Panel("Glass")
# Set the layer to put this object into
layer = Panel("Facade Skin")

# ----
# 4. Create a View
swatch = ColourSwatch(SwatchColor=RGB(85, 0, 255))

# ---- group: Opacity of the mesh
number_slider_2 = Slider(0.8, range=0..1)

# ---- group: Make mesh faceted
toggle = BooleanToggle(False)

# ---- group: Color to apply to the mesh
swatch_2 = ColourSwatch(SwatchColor=RGB(85, 111, 255))

# ---- group: Create a Basic Material for a Line
spectacles_linebasicmaterial = Spectacles_LineBasicMaterial(Color=swatch, LineWeight=1)

# ----
pt = ConstructPoint(XCoordinate=0, YCoordinate=0, ZCoordinate=0)
pt_2 = ConstructPoint(XCoordinate=0, YCoordinate=0, ZCoordinate=Slider(25, range=0..100))
pt_3 = ConstructPoint(XCoordinate=0, YCoordinate=0, ZCoordinate=Slider(54, range=0..100))
circle = CircleCNR(Center=pt_2, Normal=Vector(0, 0, 1), Radius=Slider(6.8, range=0..10))
circle_2 = CircleCNR(Center=pt, Normal=Vector(0, 0, 1), Radius=number_slider)
circle_3 = CircleCNR(Center=pt_3, Normal=Vector(0, 0, 1), Radius=Slider(4.3, range=0..10))

# ---- group: Create a Lambert Material
spectacles_meshlambertmaterial = Spectacles_MeshLambertMaterial(Color=swatch_2, AmbientColor=swatch_2, EmissiveColor=RGB(0, 0, 0), Object_Opacity=number_slider_2, SmoothEdges=toggle)

# ----
pt_4 = ConstructPoint(XCoordinate=0, YCoordinate=0, ZCoordinate=Slider(36, range=0..100))
pt_5 = ConstructPoint(XCoordinate=Slider(50, range=0..100), YCoordinate=0, ZCoordinate=0)

# ---- group: RH_Input
pt_6 = Point(Point(0, 0, 0))

pt_7 = Point(Point(0, 0, 0))

# ----
vec2pt = Vector2Pt(PointA=pt_5, PointB=pt_4, Unitize=False)  # -> Vector, Length

# ---- group: Input
pt_8 = Point(Point(0, 0, 0))

pt_9 = Point(Point(0, 0, 0))

# ---- group: Spectacles view
spectacles_views = Spectacles_Views(EyePosition=pt_5, Target=pt_4, Name="viewSample")

# ---- group: Visualize view
vdisex = VectorDisplayEx(Point=pt_5, Vector=vec2pt.Vector, Colour=RGB(0, 0, 0), Width=2)

# ---- group: Operation
pt_10 = Point(Point(0, 0, 0))

pt_11 = Point(Point(0, 0, 0))

# ----
crv = Curve(circle)
crv_2 = Curve(circle_2)
crv_3 = Curve(circle_3)

# ---- group: Output
pt_12 = Point(Point(0, 0, 0))

pt_13 = Point(Point(0, 0, 0))

# ---- group: Visualization
pt_14 = Point(Point(0, 0, 0))

pt_15 = Point(Point(0, 0, 0))

# ---- group: Meshed surface
merge = Merge(Data1=crv_2, Data2=crv, Data3=crv_3)
loft = Loft(Curves=merge, Options={Adjust=False, Closed=False, LoftEnds=0, LoftSimp=0, LoftType=0, Rebuild=10, Refit=0.01})
mesh_uv = MeshSurface(Surface=loft, UCount=Slider(37, range=0..100), VCount=Slider(46, range=0..100), Overhang=True, Equalize=False)

# ----
# Change the path to your folder
# Set to True to export geometry
panel = Panel("C:\Users\AGarciaPuyol\Desktop\MeshLambert_LineBasic.json")
export = BooleanToggle(False)

# ---- group: GH Output Mesh
mesh = Mesh(mesh_uv)

# ---- group: Mesh to export
# 2. Create a Mesh Element
mesh_2 = Mesh(mesh)

# 3. Create Line Elements
mesh_3 = Mesh(mesh)

# ----
medges = MeshEdges(Mesh=mesh_3)  # -> NakedEdges, InteriorEdges, NonManifoldEdges

# ---- group: Spectacles Mesh Element
spectacles_mesh = Spectacles_Mesh(
    Mesh=mesh_2,
    MeshMaterial=spectacles_meshlambertmaterial,
    AttributeNames=attribute_names,
    AttributeValues=attribute_values,
    Layer=layer)

# ---- group: Spectacles Line Element
spectacles_line = Spectacles_Line(Line=[medges.InteriorEdges, medges.NakedEdges], LineMaterial=spectacles_linebasicmaterial)

# ----
# 5. Export Spectacles model
spectacles_scenecompiler = Spectacles_SceneCompiler(Write=export, FilePath=panel, Elements=flatten([spectacles_mesh, spectacles_views, spectacles_line]))
